# Grasshopper definition Untitled.gh (Grasshopper 1.0.7)
# plug-ins: Pufferfish, Weaverbird

pt = Point([Point(-43.5782722, 148.3630443, 0), Point(-91.3841298, 85.26837747, 0), Point(-102.1033835, 180.8461821, 0)])
number_slider = Slider(40.1, range=0..100)
lng = ListLength(List=pt)
pline = PolyLine(Vertices=pt, Closed=True)
random = Random(Range=Domain(1, 1.5), Number=lng, Seed=2)
Z = UnitZ(Factor=Slider(20, range=0..100))
line = Line([Line((28.45003726, -19.87127776, 0), (-38.08159047, -23.94753931, 0)), Line((-66.98052281, 2.509787156, 0), (-79.63100367, 38.98677276, 0)), Line((-19.77687708, 54.19412278, 0), (43.13881948, 31.48333725, 0))])
pt_2 = Point(Point(-80.2907791, 139.8183792, 0))
subtraction = Subtraction(A=pt, B=pt_2)
lng_2 = ListLength(List=subtraction)
random_2 = Random(Range=Domain(1, 1.5), Number=lng_2, Seed=2)
unit = UnitVector(Vector=subtraction)
divide = DivideCurve(Curve=pline, Count=1, Kinks=True)  # -> Points, Tangents, Parameters
multiplication = Multiplication(A=random_2, B=number_slider)
multiplication_2 = Multiplication(A=random, B=Slider(100, range=0..100))
move = Move(Geometry=line, Motion=Z)  # -> Geometry, Transform
shatter = Shatter(Curve=pline, Parameters=divide.Parameters)
wbloop = WeaverbirdsLoopSubdivision(Level=1, SmoothNakedEdges=1)
ln_closer = GhPythonScript(lns=line)  # -> out, lns; inputs lns: list of Line
# ---------- ln_closer: Python ----------
import Rhino.Geometry as rg

starts = []
ends = []

for ln in lns:
    starts.append(rg.Point3d(ln.From) )
    ends.append(rg.Point3d(ln.To) )
    
for i in range(len(starts) ):
    lns.append(rg.Line(ends[i-1], starts[i]) )
# ---------- end ln_closer ----------
Z_2 = UnitZ(Factor=multiplication_2)
multiplication_3 = Multiplication(A=unit, B=multiplication)
scale = Scale(Geometry=move.Geometry, Center=Point(0, 0, 0), Factor=Slider(1.21, range=0..10))  # -> Geometry, Transform
end = EndPoints(Curve=shatter)  # -> Start, End
pt_3 = Point()
move_2 = Move(Geometry=pt, Motion=Z_2)  # -> Geometry, Transform
python = GhPythonScript(top_pts=move_2.Geometry, bot_pts=pt_2, sc_sides=Slider(100, range=0..100), sc_tops=Slider(40.1, range=0..100))  # -> out, a; inputs top_pts: list of Point3d, bot_pts: Point3d; unedited script template
end_2 = EndPoints(Curve=line)  # -> Start, End
line_2 = Line(ln_closer.lns)
ln_closer_2 = GhPythonScript(lns=scale.Geometry)  # -> out, lns; inputs lns: list of Line; same code as ln_closer
addition = Addition(A=end.Start, B=end.End)
addition_2 = Addition(A=pt, B=multiplication_3)
division = Division(A=addition, B=2)
unit_2 = UnitVector(Vector=subtraction)
end_3 = EndPoints(Curve=ln_closer_2.lns)  # -> Start, End
end_4 = EndPoints(Curve=ln_closer.lns)  # -> Start, End
ln = Line(StartPoint=pt_2, EndPoint=move_2.Geometry)
subtraction_2 = Subtraction()
ln_2 = Line(StartPoint=end_4.Start, EndPoint=end_3.Start)
merge = Merge(Data1=ln_closer.lns, Data2=ln_2, Data3=ln_closer_2.lns)
lng_3 = ListLength(List=division)
pt_4 = Point(pt_2)
random_3 = Random(Range=Domain(1, 1.5), Number=lng_3, Seed=2)
subtraction_3 = Subtraction(A=division, B=pt_4)
wbweave = WeaverbirdsMeshFromLinesWeaveBack(Lines=merge, MaximumValence=Slider(6, range=0..10))
multiplication_4 = Multiplication(A=random_3, B=number_slider)
number_slider_2 = Slider(2, range=0..10)
clsmsh = CloseMesh(Mesh=wbweave, Quadrangulate=True)  # -> Closed, Amount, Openings, R
unit_3 = UnitVector(Vector=subtraction_3)
medges = MeshEdges(Mesh=clsmsh.Closed)  # -> NakedEdges, InteriorEdges, NonManifoldEdges
wbcatmullclark = WeaverbirdsCatmullClarkSubdivision(MeshCurves=clsmsh.Closed, Level=number_slider_2, SmoothNakedEdges=1)
multiplication_5 = Multiplication(A=unit_3, B=multiplication)
addition_3 = Addition(A=multiplication_5, B=pt_4)
wbcatmullclark_2 = WeaverbirdsCatmullClarkSubdivision(MeshCurves=wbcatmullclark, Level=number_slider_2, SmoothNakedEdges=1)
merge_2 = Merge(Data1=addition_2)
