# Grasshopper definition cat_struct.gh (Grasshopper 1.0.7)
# plug-ins: Pufferfish, Weaverbird

pt = Point([Point(-43.5782722, 148.3630443, 0), Point(-91.3841298, 85.26837747, 0), Point(-102.1033835, 180.8461821, 0)])
number_slider = Slider(40.1, range=0..100)
lng = ListLength(List=pt)
pline = PolyLine(Vertices=pt, Closed=True)
random = Random(Range=Domain(1, 1.5), Number=lng, Seed=2)
Z = UnitZ(Factor=Slider(20, range=0..100))
line = Line([Line((28.45003726, -19.87127776, 0), (-38.08159047, -23.94753931, 0)), Line((-66.98052281, 2.509787156, 0), (-79.63100367, 38.98677276, 0)), Line((-19.77687708, 54.19412278, 0), (43.13881948, 31.48333725, 0))])
pt_2 = Point(Point(-80.2907791, 139.8183792, 0))
subtraction = Subtraction(A=pt, B=pt_2)
lng_2 = ListLength(List=subtraction)
random_2 = Random(Range=Domain(1, 1.5), Number=lng_2, Seed=2)
unit = UnitVector(Vector=subtraction)
divide = DivideCurve(Curve=pline, Count=1, Kinks=True)  # -> Points, Tangents, Parameters
multiplication = Multiplication(A=random_2, B=number_slider)
multiplication_2 = Multiplication(A=random, B=Slider(100, range=0..100))
move = Move(Geometry=line, Motion=Z)  # -> Geometry, Transform
shatter = Shatter(Curve=pline, Parameters=divide.Parameters)
wbloop = WeaverbirdsLoopSubdivision(Level=1, SmoothNakedEdges=1)
ln_closer = GhPythonScript(lns=line)  # -> out, lns; inputs lns: list of Line
# ---------- ln_closer: Python ----------
import Rhino.Geometry as rg

starts = []
ends = []

for ln in lns:
    starts.append(rg.Point3d(ln.From) )
    ends.append(rg.Point3d(ln.To) )
    
for i in range(len(starts) ):
    lns.append(rg.Line(ends[i-1], starts[i]) )
# ---------- end ln_closer ----------
Z_2 = UnitZ(Factor=multiplication_2)
multiplication_3 = Multiplication(A=unit, B=multiplication)
scale = Scale(Geometry=move.Geometry, Center=Point(0, 0, 0), Factor=Slider(1.21, range=0..10))  # -> Geometry, Transform
end = EndPoints(Curve=shatter)  # -> Start, End
pt_3 = Point()
move_2 = Move(Geometry=pt, Motion=Z_2)  # -> Geometry, Transform
python = GhPythonScript(top_pts=move_2.Geometry, bot_pts=pt_2, sc_sides=Slider(100, range=0..100), sc_tops=Slider(40.1, range=0..100))  # -> out, a; inputs top_pts: list of Point3d, bot_pts: Point3d; unedited script template
end_2 = EndPoints(Curve=line)  # -> Start, End
line_2 = Line(ln_closer.lns)
ln_closer_2 = GhPythonScript(lns=scale.Geometry)  # -> out, lns; inputs lns: list of Line; same code as ln_closer
addition = Addition(A=end.Start, B=end.End)
addition_2 = Addition(A=pt, B=multiplication_3)
division = Division(A=addition, B=2)
unit_2 = UnitVector(Vector=subtraction)
end_3 = EndPoints(Curve=ln_closer_2.lns)  # -> Start, End
end_4 = EndPoints(Curve=ln_closer.lns)  # -> Start, End
ln = Line(StartPoint=pt_2, EndPoint=move_2.Geometry)
subtraction_2 = Subtraction()
ln_2 = Line(StartPoint=end_4.Start, EndPoint=end_3.Start)
merge = Merge(Data1=ln_closer.lns, Data2=ln_2, Data3=ln_closer_2.lns)
lng_3 = ListLength(List=division)
pt_4 = Point(pt_2)
crv = Curve([<curve referenced from the Rhino model> x130])
random_3 = Random(Range=Domain(1, 1.5), Number=lng_3, Seed=2)
crv_2 = Curve([<curve referenced from the Rhino model> x291])
number_slider_2 = Slider(10, range=0..10)
crv_3 = Curve([<curve referenced from the Rhino model> x291])
subtraction_3 = Subtraction(A=division, B=pt_4)
wbweave = WeaverbirdsMeshFromLinesWeaveBack(Lines=merge, MaximumValence=Slider(6, range=0..10))
crv_4 = Curve([<curve referenced from the Rhino model> x65])
line_3 = Line(crv_3)
multiplication_4 = Multiplication(A=random_3, B=number_slider)
number_slider_3 = Slider(2, range=0..10)
crv_5 = Curve(graft([<curve referenced from the Rhino model> x9]))
pt_5 = Point(Point(-276.049541, -316.2989023, 0))
clsmsh = CloseMesh(Mesh=wbweave, Quadrangulate=True)  # -> Closed, Amount, Openings, R
unit_3 = UnitVector(Vector=subtraction_3)
wbweave_2 = WeaverbirdsMeshFromLinesWeaveBack(Lines=line_3, MaximumValence=4)
series = Series(Start=0, Step=Slider(100, range=0..100), Count=number_slider_2)
medges = MeshEdges(Mesh=clsmsh.Closed)  # -> NakedEdges, InteriorEdges, NonManifoldEdges
series_2 = Series(Start=Slider(1, range=0..1), Step=Slider(0.14, range=0..1), Count=number_slider_2)
wbcatmullclark = WeaverbirdsCatmullClarkSubdivision(MeshCurves=clsmsh.Closed, Level=number_slider_3, SmoothNakedEdges=1)
multiplication_5 = Multiplication(A=unit_3, B=multiplication)
Z_3 = UnitZ(Factor=series)
wbcatmullclark_2 = WeaverbirdsCatmullClarkSubdivision(MeshCurves=wbweave_2, Level=Slider(3, range=0..10), SmoothNakedEdges=1)
addition_3 = Addition(A=multiplication_5, B=pt_4)
wbcatmullclark_3 = WeaverbirdsCatmullClarkSubdivision(MeshCurves=wbcatmullclark, Level=number_slider_3, SmoothNakedEdges=1)
mesh = Mesh(wbcatmullclark_2)
scale_2 = Scale(Geometry=crv_5, Center=pt_5, Factor=series_2)  # -> Geometry, Transform
merge_2 = Merge(Data1=addition_2)
wbcatmullclark_4 = WeaverbirdsCatmullClarkSubdivision(MeshCurves=wbcatmullclark_2, Level=Slider(2, range=0..10), SmoothNakedEdges=1)  # disabled
move_3 = Move(Geometry=scale_2.Geometry, Motion=Z_3)  # -> Geometry, Transform
number_slider_4 = Slider(3, range=2..10)
Y = UnitY(Factor=Slider(3, range=0..100))
xy = XYPlane(Origin=Point(0, 0, 0))
Y_2 = UnitY(Factor=Slider(1, range=0..100))
division_2 = Division(A=6.283185307, B=number_slider_4)
Y_3 = UnitY(Factor=Slider(1, range=0..100))
Y_4 = UnitY(Factor=Slider(1, range=0..100))
Z_4 = UnitZ(Factor=Slider(18, range=0..100))
pt_6 = Point(Point(0, 0, 0))
Z_5 = UnitZ(Factor=Slider(10, range=0..10))
Y_5 = UnitY(Factor=Slider(2, range=0..100))
Z_6 = UnitZ(Factor=Slider(21, range=0..100))
Z_7 = UnitZ(Factor=Slider(26, range=0..100))
Z_8 = UnitZ(Factor=Slider(28, range=0..100))
Y_6 = UnitY(Factor=Slider(2, range=0..100))
move_4 = Move(Geometry=xy, Motion=Y)  # -> Geometry, Transform
Z_9 = UnitZ(Factor=Slider(31, range=0..100))
move_5 = Move(Geometry=xy, Motion=Y_2)  # -> Geometry, Transform
Z_10 = UnitZ(Factor=Slider(36, range=0..100))
series_3 = Series(Start=0, Step=division_2, Count=number_slider_4)
move_6 = Move(Geometry=xy, Motion=Y_3)  # -> Geometry, Transform
move_7 = Move(Geometry=xy, Motion=Y_4)  # -> Geometry, Transform
move_8 = Move(Geometry=xy, Motion=Y_5)  # -> Geometry, Transform
move_9 = Move(Geometry=xy, Motion=Y_6)  # -> Geometry, Transform
rotate = Rotate(Geometry=xy, Angle=series_3, Plane=pt_6)  # -> Geometry, Transform
rotate_2 = Rotate(Geometry=move_4.Geometry, Angle=series_3, Plane=pt_6)  # -> Geometry, Transform
rotate_3 = Rotate(Geometry=move_5.Geometry, Angle=series_3, Plane=pt_6)  # -> Geometry, Transform
rotate_4 = Rotate(Geometry=move_6.Geometry, Angle=series_3, Plane=pt_6)  # -> Geometry, Transform
rotate_5 = Rotate(Geometry=move_7.Geometry, Angle=series_3, Plane=pt_6)  # -> Geometry, Transform
rotate_6 = Rotate(Geometry=move_8.Geometry, Angle=series_3, Plane=pt_6)  # -> Geometry, Transform
pt_7 = Point(Point(0, 0, 0))
xy_2 = XYPlane(Origin=Point(0, 0, 0))
rotate_7 = Rotate(Geometry=move_9.Geometry, Angle=series_3, Plane=pt_6)  # -> Geometry, Transform
move_10 = Move(Geometry=rotate_2.Geometry, Motion=Z_4)  # -> Geometry, Transform
number_slider_5 = Slider(4.8, range=0..10)
move_11 = Move(Geometry=rotate.Geometry, Motion=Z_5)  # -> Geometry, Transform
move_12 = Move(Geometry=rotate_3.Geometry, Motion=Z_6)  # -> Geometry, Transform
number_slider_6 = Slider(8.568, range=0..10)
number_slider_7 = Slider(8.038, range=0..10)
number_slider_8 = Slider(24, range=0..100)
move_13 = Move(Geometry=rotate_4.Geometry, Motion=Z_7)  # -> Geometry, Transform
move_14 = Move(Geometry=rotate_5.Geometry, Motion=Z_8)  # -> Geometry, Transform
move_15 = Move(Geometry=rotate_6.Geometry, Motion=Z_9)  # -> Geometry, Transform
rotate_8 = Rotate(Geometry=xy_2, Angle=series_3, Plane=pt_7)  # -> Geometry, Transform
move_16 = Move(Geometry=rotate_7.Geometry, Motion=Z_10)  # -> Geometry, Transform
number_slider_9 = Slider(3, range=2..10)
pt_8 = Point(Point(14.69391495, 11.71348803, 0))
python_2 = GhPythonScript(plns=move_10.Geometry, l=Slider(4.081, range=0..10), w=Slider(3.141, range=0..10), r=Slider(0.4, range=0..10))  # -> out, a, b, leafs, Leaf; inputs plns: list of Plane
# ---------- python_2: Python ----------
import Rhino.Geometry as rg

class Leaf:
    def __init__(self, pln, l, w, r):
        self.pln = pln
        self.l = l
        self.w = w
        self.r = r
        
        self._pt_get()
        
    def _pt_get(self):
        o = rg.Point3d(self.pln.Origin)
        x = rg.Point3d(self.pln.XAxis)
        y = rg.Point3d(self.pln.YAxis)
        
        print("x axis : " + str(x))
        print("y axis : " + str(y))
        
        self.p_o = o
        self.p_e = rg.Point3d(o + self.l * y)
        self.p_r = rg.Point3d(o + self.r * y + self.w * .5 * x)
        self.p_l = rg.Point3d(o + self.r * y - self.w * .5 * x)
        
        print("p_e : " + str(self.p_e) )
        print("p_r : " + str(self.p_r) )
        print("p_l : " + str(self.p_l) )
        
    def copy(self):
        n_leaf = Leaf(self.pln, self.l, self.w, self.r)
        n_leaf.p_o = self.p_o
        n_leaf.p_e = self.p_e
        n_leaf.p_r = self.p_r
        n_leaf.p_l = self.p_l
        
        return n_leaf
        
    @property
    def pts(self):
        return [self.p_o, self.p_r, self.p_e, self.p_l]
        
    def pl_repr(self):
        return rg.Polyline(self.pts + [self.p_o])
    
    @staticmethod
    def align_leafs(leaf_list):
        l_s = [leaf.p_l for leaf in leaf_list]
        r_s = [leaf.p_r for leaf in leaf_list]
        c_s = [leaf.p_o for leaf in leaf_list]
        
        p_o_n = rg.Point3d.Origin
        for p_o in c_s:
            p_o_n += p_o
            
        p_o_n /= len(c_s)
        
        for i in range(len(c_s) ):
            avg_pt = (r_s[(i+1)%len(c_s)] + l_s[i]) * .5
            leaf_list[(i+1)%len(c_s)].p_r = avg_pt
            leaf_list[i].p_l = avg_pt
            
    @property
    def side_a(self):
        return [self.p_o, self.p_r]
        
    @property
    def side_b(self):
        return [self.p_r, self.p_e]

    @property
    def side_c(self):
        return [self.p_e, self.p_l]
        
    @property
    def side_d(self):
        return [self.p_l, self.p_o]
            
leafs = [Leaf(p, l, w, r) for p in plns]
a = [l.pl_repr() for l in leafs]
print(leafs[0].side_b)
# ---------- end python_2 ----------
python_3 = GhPythonScript(plns=move_11.Geometry, l=Slider(4.081, range=0..10), w=Slider(3.141, range=0..10), r=Slider(0.4, range=0..10))  # -> out, a, b, leafs, Leaf; inputs plns: list of Plane; same code as python_2
python_4 = GhPythonScript(plns=move_12.Geometry, l=Slider(6.899, range=0..10), w=Slider(3.358, range=0..10), r=Slider(2, range=0..10))  # -> out, a, b, leafs, Leaf; inputs plns: list of Plane; same code as python_2
python_5 = GhPythonScript(plns=move_13.Geometry, l=Slider(7.784, range=0..10), w=Slider(4.788, range=0..10), r=Slider(2.7, range=0..10))  # -> out, a, b, leafs, Leaf; inputs plns: list of Plane; same code as python_2
python_6 = GhPythonScript(plns=move_14.Geometry, l=Slider(8.568, range=0..10), w=Slider(8.038, range=0..10), r=Slider(4.8, range=0..10))  # -> out, a, b, leafs, Leaf; inputs plns: list of Plane; same code as python_2
Y_7 = UnitY(Factor=number_slider_8)
Z_11 = UnitZ(Factor=Slider(100, range=0..100))
python_7 = GhPythonScript(plns=move_15.Geometry, l=Slider(8.568, range=0..10), w=Slider(8.038, range=0..10), r=Slider(4.8, range=0..10))  # -> out, a, b, leafs, Leaf; inputs plns: list of Plane; same code as python_2
python_8 = GhPythonScript(plns=move_16.Geometry, l=number_slider_6, w=number_slider_7, r=number_slider_5)  # -> out, a, b, leafs, Leaf; inputs plns: list of Plane; same code as python_2
division_3 = Division(A=6.283185307, B=number_slider_9)
addition_4 = Addition(A=Y_7, B=Z_11)
series_4 = Series(Start=0, Step=division_3, Count=number_slider_9)
move_17 = Move(Geometry=pt_8, Motion=addition_4)  # -> Geometry, Transform
series_5 = Series(Start=0.5, Step=0.5, Count=10)
python_9 = GhPythonScript(plns=rotate_8.Geometry, l=Slider(2.147, range=0..10), w=Slider(1.262, range=0..10), r=Slider(0.4, range=0..10))  # -> out, a, b, leafs, Leaf; inputs plns: list of Plane
# ---------- python_9: Python ----------
import Rhino.Geometry as rg

class Leaf:
    def __init__(self, pln, l, w, r):
        self.pln = pln
        self.l = l
        self.w = w
        self.r = r
        
        self._pt_get()
        
    def _pt_get(self):
        o = rg.Point3d(self.pln.Origin)
        x = rg.Point3d(self.pln.XAxis)
        y = rg.Point3d(self.pln.YAxis)
        
        print("x axis : " + str(x))
        print("y axis : " + str(y))
        
        self.p_o = o
        self.p_e = rg.Point3d(o + self.l * y)
        self.p_r = rg.Point3d(o + self.r * y + self.w * .5 * x)
        self.p_l = rg.Point3d(o + self.r * y - self.w * .5 * x)
        
        print("p_e : " + str(self.p_e) )
        print("p_r : " + str(self.p_r) )
        print("p_l : " + str(self.p_l) )
        
    def copy(self):
        n_leaf = Leaf(self.pln, self.l, self.w, self.r)
        n_leaf.p_o = self.p_o
        n_leaf.p_e = self.p_e
        n_leaf.p_r = self.p_r
        n_leaf.p_l = self.p_l
        
        return n_leaf
        
    @property
    def pts(self):
        return [self.p_o, self.p_r, self.p_e, self.p_l]
        
    def pl_repr(self):
        return rg.Polyline(self.pts + [self.p_o])
    
    @staticmethod
    def align_leafs(leaf_list):
        l_s = [leaf.p_l for leaf in leaf_list]
        r_s = [leaf.p_r for leaf in leaf_list]
        c_s = [leaf.p_o for leaf in leaf_list]
        
        p_o_n = rg.Point3d.Origin
        for p_o in c_s:
            p_o_n += p_o
            
        p_o_n /= len(c_s)
        for leaf in leaf_list:
            leaf.p_o = p_o_n
        
        for i in range(len(c_s) ):
            avg_pt = (r_s[(i+1)%len(c_s)] + l_s[i]) * .5
            leaf_list[(i+1)%len(c_s)].p_r = avg_pt
            leaf_list[i].p_l = avg_pt
            
    @property
    def side_a(self):
        return [self.p_o, self.p_r]
        
    @property
    def side_b(self):
        return [self.p_r, self.p_e]

    @property
    def side_c(self):
        return [self.p_e, self.p_l]
        
    @property
    def side_d(self):
        return [self.p_l, self.p_o]
            
leafs = [Leaf(p, l, w, r) for p in plns]
a = [l.pl_repr() for l in leafs]
print(leafs[0].side_b)
# ---------- end python_9 ----------
merge_3 = Merge(
    Data1=python_9.leafs,
    Data2=python_3.leafs,
    Data3=python_2.leafs,
    Data4=python_4.leafs,
    Data5=python_5.leafs,
    Data6=python_6.leafs,
    Data7=python_7.leafs,
    Data8=python_8.leafs)
move_18 = Move(Motion=Vector(0, 0, 10))  # -> Geometry, Transform
series_6 = Series(Start=0, Step=1, Count=10)
python_10 = GhPythonScript(x=merge_3, segmentation=number_slider_4)  # -> out, a; inputs x: list, segmentation: Int32
# ---------- python_10: Python ----------
a = []
for i in range(int(len(x) / segmentation) ):
    loc_list = []
    for j in range(segmentation):
        loc_list.append(x[i * segmentation + j])
    a.append(loc_list)
# ---------- end python_10 ----------
round = Round(Number=series_5)  # -> Nearest, Floor, Ceiling
line_4 = Line()
ln_3 = Line(StartPoint=pt_8, EndPoint=move_17.Geometry)
number_slider_10 = Slider(16, range=0..20)
panel = Panel(python_9.out)
mod = Modulus(A=round.Ceiling, B=2)
rotate_9 = Rotate(Geometry=ln_3, Angle=series_4, Plane=pt_8)  # -> Geometry, Transform
item = ListItem(List=python_9.b, Index=0, Wrap=True)
item_2 = ListItem(List=python_9.b, Index=0, Wrap=True)
crv_6 = Curve(python_9.b)
python_11 = GhPythonScript(leaf_lists=python_10.a)  # -> out, a; inputs leaf_lists: list
# ---------- python_11: Python ----------
lfs = []

for leaf_list in leaf_lists:
    lfs.extend(leaf_list)

a = [leaf.pl_repr() for leaf in lfs]
# ---------- end python_11 ----------
python_12 = GhPythonScript(Leaf=python_9.Leaf, leaf_lists=python_10.a, alignments=mod)  # -> out, v_list, f_list; inputs leaf_lists: list, alignments: list of Int32
# ---------- python_12: Python ----------
class LeafLayer:
    def __init__(self, leafs):
        # self.leafs = leafs
        self.leafs = [leaf.copy() for leaf in leafs]
        self._is_aligned = False
        
    def align(self):
        self._is_aligned = True
        Leaf.align_leafs(self.leafs)
        
    @property
    def is_aligned(self):
        return self._is_aligned
        
    @property
    def face_pts(self):
        return [leaf.pts for leaf in self.leafs]

def front_linking(leaf_layer_a, leaf_layer_b):
    
    pt_lists = []
    
    for i, l in enumerate(leaf_layer_b.leafs):
        l_side_b = l.side_b
        l_side_b.reverse()
        
        l_side_c = l.side_c
        l_side_c.reverse()
        
        pt_lists.append(leaf_layer_a.leafs[i].side_b + l_side_b)
        pt_lists.append(leaf_layer_a.leafs[i].side_c + l_side_c)
        
    lens = [len(pt_list) for pt_list in pt_lists]
    lens = list(set(lens) )
    
    print("front_linking : created {} faces, with lengths {}".format(len(pt_lists), lens) )
    return pt_lists
    
def front_and_back_linking(leaf_layer_a, leaf_layer_b):
    
    pt_lists = front_linking(leaf_layer_a, leaf_layer_b)
    
    for i, l in enumerate(leaf_layer_b.leafs):
        l_side_a = l.side_a
        l_side_a.reverse()
        
        l_side_d = l.side_d
        l_side_d.reverse()
        
        pt_lists.append(leaf_layer_a.leafs[i].side_a + l_side_a)
        pt_lists.append(leaf_layer_a.leafs[i].side_d + l_side_d)
        
    lens = [len(pt_list) for pt_list in pt_lists]
    lens = list(set(lens) )
        
    print("front_and_back_linking : created {} faces, with lengths {}".format(len(pt_lists), lens) )
        
    return pt_lists

def link_2_layers(leaf_layer_a, leaf_layer_b):
    if leaf_layer_a.is_aligned and leaf_layer_b.is_aligned:
        return front_linking(leaf_layer_a, leaf_layer_b)
    else:
        return front_and_back_linking(leaf_layer_a, leaf_layer_b)

def reduce_pts_to_v_list(leaf_pts_lists):
    v_list = []
    for leaf_pts in leaf_pts_lists:
        for pt in leaf_pts:
            not_yet = True
            for n_p in v_list:
                if n_p.DistanceTo(pt) < .001:
                    not_yet = False
                    break
            if not_yet:
                v_list.append(pt)
                    
    f_list = []
    for leaf_pts in leaf_pts_lists:
        face_i_list = []
        for pt in leaf_pts:
            for i, n_p in enumerate(v_list):
                if n_p.DistanceTo(pt) < .001:
                    face_i_list.append(i)
                    break
        f_list.append(face_i_list)
        
    return v_list, f_list

def leaf_layer_linking(leaf_layers):
    pt_lists = []
    # bottom layer generation -> need to be inversed
    for face in leaf_layers[0].face_pts:
        face.reverse()
        pt_lists.append(face)
        
    for i in range(len(leaf_layers) - 1):
        pt_lists.extend(link_2_layers(leaf_layers[i], leaf_layers[i + 1]) )
    
    # top layer generation
    pt_lists.extend(leaf_layers[-1].face_pts)
    
    lens = [len(pt_list) for pt_list in pt_lists]
    lens = list(set(lens) )
        
    print("leaf_layer_linking : created {} faces, with lengths {}".format(len(pt_lists), lens) )
    
    return pt_lists

leaf_layers = []
for i, leafs in enumerate(leaf_lists):
    local_leaf_layer = LeafLayer(leafs)
    if alignments[i%len(alignments)] == 1 :
        local_leaf_layer.align()
        
    leaf_layers.append(local_leaf_layer)
        
leaf_pts_lists = leaf_layer_linking(leaf_layers)
v_list, f_list = reduce_pts_to_v_list(leaf_pts_lists)
# ---------- end python_12 ----------
series_7 = Series(Start=1, Step=Slider(0.12, range=0..1), Count=number_slider_9)
addition_5 = Addition(A=number_slider_10, B=-1)
end_5 = EndPoints(Curve=rotate_9.Geometry)  # -> Start, End
panel_2 = Panel(python_11.a)
python_13 = GhPythonScript(plns=move_16.Geometry, l=number_slider_6, w=number_slider_7, r=number_slider_5)  # -> out, a, b, leafs, Leaf; inputs plns: list of Plane; same code as python_2
division_4 = Division(A=1, B=addition_5)
scale_3 = Scale(Geometry=rotate_9.Geometry, Center=pt_8, Factor=series_7)  # -> Geometry, Transform
subtraction_4 = Subtraction(A=end_5.End, B=end_5.Start)
panel_3 = Panel(python_12.out)
series_8 = Series(Start=0, Step=division_4, Count=number_slider_10)
multiplication_6 = Multiplication(A=series_8, B=graft(series_7))
unit_4 = UnitVector(Vector=subtraction_4)
python_14 = GhPythonScript(v_list=python_12.v_list, f_list=python_12.f_list)  # -> out, msh; inputs v_list: list of Point3d, f_list: list
# ---------- python_14: Python ----------
import Rhino.Geometry as rg

msh = rg.Mesh()

for v in v_list:
    msh.Vertices.Add(v)
    
for a, b, c, d in f_list:
    msh.Faces.AddFace(a, b, c, d)
# ---------- end python_14 ----------
eval = EvaluateCurve(Curve=graft(rotate_9.Geometry), Parameter=multiplication_6)  # -> graft(Point), Tangent, Angle
ma = MassAddition(Input=unit_4)  # -> Result, PartialResults
path_mapper = PathMapper(eval.Point, source="{A;B;C;D}", target="{D}")
int = Integer(number_slider_9)
division_5 = Division(A=ma.Result, B=int)
wbsplitpolygons = WeaverbirdsSplitPolygonsSubdivision(MeshCurves=python_14.msh, Level=1, SmoothNakedEdges=1)
medges_2 = MeshEdges(Mesh=python_14.msh)  # -> NakedEdges, InteriorEdges, NonManifoldEdges
ma_2 = MassAddition(Input=path_mapper)  # -> Result, PartialResults
unit_5 = UnitVector(Vector=division_5)
number_slider_11 = Slider(0.4, range=0..1)
wbcatmullclark_5 = WeaverbirdsCatmullClarkSubdivision(MeshCurves=python_14.msh, Level=Slider(3, range=0..10), SmoothNakedEdges=1)
division_6 = Division(A=ma_2.Result, B=int)
panel_4 = Panel(division_6)
subtraction_5 = Subtraction(A=path_mapper, B=division_6)
panel_5 = Panel(wbcatmullclark_5)
vlen = VectorLength(Vector=subtraction_5)
unit_6 = UnitVector(Vector=subtraction_5)
number_slider_12 = Slider(0.001, range=0..0.001)
number_slider_13 = Slider(0.001, range=0..0.001)
xprod = CrossProduct(VectorA=unit_6, VectorB=unit_5, Unitize=False)  # -> Vector, Length
demesh = DeconstructMesh(Mesh=wbcatmullclark_5)  # -> Vertices, Faces, Colours, Normals
number_slider_14 = Slider(0.00576, range=0..0.1)
num = Number(number_slider_8)
multiplication_7 = Multiplication(A=subtraction_5, B=number_slider_11)
multiplication_8 = Multiplication(A=Slider(2.728, range=0..10), B=vlen)
multiplication_9 = Multiplication(A=Slider(0.549, range=0..10), B=vlen)
cluster = Cluster(B_3=Slider(0.649, range=0..1), A=vlen, B_2=Slider(1.6, range=0..10), B=number_slider_11)
multiplication_10 = Multiplication(A=number_slider_11, B=num)
move_19 = Move(Geometry=division_6, Motion=multiplication_7)  # -> Geometry, Transform
pl = ConstructPlane(Origin=move_19.Geometry, XAxis=xprod.Vector, YAxis=unit_6)
gyroid = GhPythonScript(pts=demesh.Vertices, sc_a=Slider(0.457, range=0..1), sc_b=Slider(0.308, range=0..1))  # -> out, a; inputs pts: list of Point3d
# ---------- gyroid: Python ----------
import math

def Gyroid(pt, sc):
    x, y, z = pt.X, pt.Y, pt.Z
    x *= sc
    y *= sc
    z *= sc
    
    s_x, c_x = math.sin(x), math.cos(x)
    s_y, c_y = math.sin(y), math.cos(y)
    s_z, c_z = math.sin(z), math.cos(z)
    
    return s_x * c_y + s_y * c_z + s_z * c_x
    
a = []

for pt in pts:
    a.append(Gyroid(pt, sc_b * Gyroid(pt, sc_a) ) )
# ---------- end gyroid ----------
addition_6 = Addition(A=multiplication_8, B=Slider(0.1, range=0..0.1))
addition_7 = Addition(A=multiplication_9, B=Slider(0.247, range=0..1))
number_slider_15 = Slider(0.00671, range=0..0.01)
path_mapper_2 = PathMapper(pl, source="{A;B}", target="{B}")
python_15 = GhPythonScript(plns=path_mapper_2, ls=cluster, ws=addition_7, rs=addition_6)  # -> out, a, b, leafs, Leaf; inputs plns: list of Plane, ls: list, ws: list, rs: list
# ---------- python_15: Python ----------
import Rhino.Geometry as rg

class Leaf:
    def __init__(self, pln, l, w, r):
        self.pln = pln
        self.l = l
        self.w = w
        self.r = r
        
        self._pt_get()
        
    def _pt_get(self):
        o = rg.Point3d(self.pln.Origin)
        x = rg.Point3d(self.pln.XAxis)
        y = rg.Point3d(self.pln.YAxis)
        
        print("x axis : " + str(x))
        print("y axis : " + str(y))
        
        self.p_o = o
        self.p_e = rg.Point3d(o + self.l * y)
        self.p_r = rg.Point3d(o + self.r * y + self.w * .5 * x)
        self.p_l = rg.Point3d(o + self.r * y - self.w * .5 * x)
        
        print("p_e : " + str(self.p_e) )
        print("p_r : " + str(self.p_r) )
        print("p_l : " + str(self.p_l) )
        
    def copy(self):
        n_leaf = Leaf(self.pln, self.l, self.w, self.r)
        n_leaf.p_o = self.p_o
        n_leaf.p_e = self.p_e
        n_leaf.p_r = self.p_r
        n_leaf.p_l = self.p_l
        
        return n_leaf
        
    @property
    def pts(self):
        return [self.p_o, self.p_r, self.p_e, self.p_l]
        
    def pl_repr(self):
        return rg.Polyline(self.pts + [self.p_o])
    
    @staticmethod
    def align_leafs(leaf_list):
        l_s = [leaf.p_l for leaf in leaf_list]
        r_s = [leaf.p_r for leaf in leaf_list]
        c_s = [leaf.p_o for leaf in leaf_list]
        
        p_o_n = rg.Point3d.Origin
        for p_o in c_s:
            p_o_n += p_o
            
        p_o_n /= len(c_s)
        
        for i in range(len(c_s) ):
            avg_pt = (r_s[(i+1)%len(c_s)] + l_s[i]) * .5
            leaf_list[(i+1)%len(c_s)].p_r = avg_pt
            leaf_list[i].p_l = avg_pt
            
    @property
    def side_a(self):
        return [self.p_o, self.p_r]
        
    @property
    def side_b(self):
        return [self.p_r, self.p_e]

    @property
    def side_c(self):
        return [self.p_e, self.p_l]
        
    @property
    def side_d(self):
        return [self.p_l, self.p_o]
            
leafs = [Leaf(p, ls[i], ws[i], rs[i]) for i, p in enumerate(plns)]
a = [l.pl_repr() for l in leafs]
print(leafs[0].side_b)
# ---------- end python_15 ----------
remap = RemapNumbers(Value=gyroid.a, Source=Domain(-1, 1), Target=Slider(0.5, range=0..10))  # -> Mapped, Clipped
multiplication_11 = Multiplication(A=demesh.Normals, B=remap.Mapped)
addition_8 = Addition(A=demesh.Vertices, B=multiplication_11)
panel_6 = Panel(python_15.out)
conmesh = ConstructMesh(Vertices=addition_8, Faces=demesh.Faces)
python_16 = GhPythonScript(x=flatten(python_15.leafs), segmentation=number_slider_4)  # -> out, a; inputs x: list, segmentation: Int32; same code as python_10
wbcatmullclark_6 = WeaverbirdsCatmullClarkSubdivision(MeshCurves=conmesh, Level=Slider(1, range=0..1), SmoothNakedEdges=1)
preview = CustomPreview(
    Geometry=wbcatmullclark_6,
    Material={diffuse=RGB(221, 160, 221), emission=RGB(66, 48, 66), shine=0.5, specular=RGB(255, 255, 255), transparency=0})
series_9 = Series(Start=0.5, Step=0.5, Count=number_slider_10)
round_2 = Round(Number=series_9)  # -> Nearest, Floor, Ceiling
mod_2 = Modulus(A=round_2.Ceiling, B=2)
python_17 = GhPythonScript(Leaf=python_9.Leaf, leaf_lists=python_16.a, alignments=mod_2)  # -> out, v_list, f_list; inputs leaf_lists: list, alignments: list of Int32; same code as python_12
panel_7 = Panel(python_17.out)
python_18 = GhPythonScript(v_list=python_17.v_list, f_list=python_17.f_list)  # -> out, msh; inputs v_list: list of Point3d, f_list: list; same code as python_14
wbsplitpolygons_2 = WeaverbirdsSplitPolygonsSubdivision(MeshCurves=python_18.msh, Level=1, SmoothNakedEdges=1)
wbcatmullclark_7 = WeaverbirdsCatmullClarkSubdivision(MeshCurves=python_18.msh, Level=Slider(3, range=0..10), SmoothNakedEdges=1)
medges_3 = MeshEdges(Mesh=python_18.msh)  # -> NakedEdges, InteriorEdges, NonManifoldEdges
wbcatmullclark_8 = WeaverbirdsCatmullClarkSubdivision(MeshCurves=wbcatmullclark_7, Level=Slider(3, range=0..10), SmoothNakedEdges=1)
panel_8 = Panel(wbcatmullclark_7)
number_slider_16 = Slider(0.001, range=0..0.001)
number_slider_17 = Slider(0.001, range=0..0.001)
demesh_2 = DeconstructMesh(Mesh=wbcatmullclark_8)  # -> Vertices, Faces, Colours, Normals
number_slider_18 = Slider(0.00576, range=0..0.1)
gyroid_2 = GhPythonScript(pts=demesh_2.Vertices, sc_a=Slider(0.457, range=0..1), sc_b=Slider(0.308, range=0..1))  # -> out, a; inputs pts: list of Point3d
# ---------- gyroid_2: Python ----------
import math

def Gyroid(pt, sc):
    x, y, z = pt.X, pt.Y, pt.Z
    x *= sc
    y *= sc
    z *= sc
    
    s_x, c_x = math.sin(x), math.cos(x)
    s_y, c_y = math.sin(y), math.cos(y)
    s_z, c_z = math.sin(z), math.cos(z)
    
    return s_x * c_y + s_y * c_z + s_z * c_x
    
a = []

for pt in pts:
    a.append(Gyroid(pt, sc_b * ( 1 + .333 * Gyroid(pt, sc_a) ) ) )
# ---------- end gyroid_2 ----------
number_slider_19 = Slider(0.00671, range=0..0.01)
remap_2 = RemapNumbers(Value=gyroid_2.a, Source=Domain(-1, 1), Target=Slider(0.5, range=0..10))  # -> Mapped, Clipped
multiplication_12 = Multiplication(A=demesh_2.Normals, B=remap_2.Mapped)
addition_9 = Addition(A=demesh_2.Vertices, B=multiplication_12)
conmesh_2 = ConstructMesh(Vertices=addition_9, Faces=demesh_2.Faces)
wbcatmullclark_9 = WeaverbirdsCatmullClarkSubdivision(MeshCurves=conmesh_2, Level=Slider(1, range=0..1), SmoothNakedEdges=1)
preview_2 = CustomPreview(
    Geometry=conmesh_2,
    Material={diffuse=RGB(221, 160, 221), emission=RGB(66, 48, 66), shine=0.5, specular=RGB(255, 255, 255), transparency=0})

# ==== cluster Cluster
A = ClusterInput()
B = ClusterInput()
B_2 = ClusterInput()
B_3 = ClusterInput()
subtraction = Subtraction(A=1, B=B)
multiplication = Multiplication(A=subtraction, B=B_2)
multiplication_2 = Multiplication(A=A, B=multiplication)
addition = Addition(A=multiplication_2, B=B_3)
R = ClusterOutput(addition)
